# Grasshopper definition clippers.gh (Grasshopper 1.0.7)

cardboard_thickness = Slider(4, range=1..8)
inner_depth = Slider(12, range=1..20)
addition = Addition(A=cardboard_thickness, B=2)
subtraction = Subtraction(A=cardboard_thickness, B=2)
plane = Plane(PlaneXY(0, 0, 0))
vector_xyz = VectorXYZ(XComponent=0, YComponent=2, ZComponent=0)  # -> Vector, Length
rectangle = Rectangle(Plane=plane, XSize=inner_depth, YSize=subtraction, Radius=0)  # -> Rectangle, Length
rectangle_2 = Rectangle(Plane=plane, XSize=Domain(0, 20), YSize=addition, Radius=0)  # -> Rectangle, Length
move = Move(Geometry=rectangle.Rectangle, Motion=vector_xyz.Vector)  # -> Geometry, Transform
region_difference = RegionDifference(CurvesA=rectangle_2.Rectangle, CurvesB=move.Geometry)
explode = Explode(Curve=region_difference, Recursive=True)  # -> Segments, Vertices

series = Series(Start=6, Step=1, Count=2)
series_2 = Series(Start=3, Step=1, Count=2)
merge = Merge(Data1=series_2, Data2=series)
list_item = ListItem(List=explode.Segments, Index=merge, Wrap=True)
corner_radius = Slider(4, range=1..5)
join_curves = JoinCurves(Curves=list_item, Preserve=False)
fillet = Fillet(Curve=join_curves, Radius=corner_radius)

series_3 = Series(Start=1, Step=1, Count=2)
list_item_2 = ListItem(List=explode.Segments, Index=series_3, Wrap=True)
series_4 = Series(Start=0, Step=5, Count=2)
corner_radius_2 = Slider(4, range=1..5)
join_curves_2 = JoinCurves(Curves=list_item_2, Preserve=False)
list_item_3 = ListItem(List=explode.Segments, Index=series_4, Wrap=True)
fillet_2 = Fillet(Curve=join_curves_2, Radius=corner_radius_2)
merge_2 = Merge(Data1=flatten(list_item_3), Data2=flatten(fillet), Data3=flatten(fillet_2))
join_curves_3 = JoinCurves(Curves=merge_2, Preserve=False)
unit_z = UnitZ(Factor=20)
boundary_surfaces = BoundarySurfaces(Edges=join_curves_3)
extrude = Extrude(Base=boundary_surfaces, Direction=unit_z)

subtraction_2 = Subtraction(A=20, B=cardboard_thickness)
subtraction_3 = Subtraction(A=subtraction_2, B=2)
multiplication = Multiplication(A=subtraction_3, B=-1)
rotate = Rotate(Geometry=extrude, Angle=3.141592654, Plane=PlaneYZ(0, 0, 0))  # -> Geometry, Transform
vector_xyz_2 = VectorXYZ(XComponent=subtraction_3, YComponent=multiplication, ZComponent=Slider(20, range=-40..40))  # -> Vector, Length
rotate_2 = Rotate(Geometry=rotate.Geometry, Angle=1.570796327, Plane=PlaneXY(0, 0, 0))  # -> Geometry, Transform
move_2 = Move(Geometry=rotate_2.Geometry, Motion=vector_xyz_2.Vector)  # -> Geometry, Transform

solid_union = SolidUnion(Breps=[move_2.Geometry, extrude])
rows = Slider(4, range=0..100)
columns = Slider(3, range=0..100)
box_array = BoxArray(
    Geometry=solid_union,
    Cell={Plane=PlaneXY(0, 0, 0), X=Domain(0, 25), Y=Domain(0, 25), Z=Domain(0, 25)},
    XCount=rows,
    YCount=columns,
    ZCount=1)  # -> Geometry, Transform
