# Grasshopper definition nestedcaps.gh (Grasshopper 1.0.7)

number_of_shape = Slider(3, range=1..10)
circle = Circle({Plane=Plane(origin=(0, 0, 0), x=(0.9924559943, 0.1226013843, 0), y=(-0.1226013843, 0.9924559943, 0)), Radius=5})
linear_array = LinearArray(Geometry=circle, Direction=Vector(0, 0, 0), Count=number_of_shape)  # -> Geometry, Transform
series = Series(Start=1, Step=1, Count=number_of_shape)
height_multiplier = Slider(4, range=1..11)
wall_thickness = Slider(1.5, range=1..5)
scale = Scale(Geometry=linear_array.Geometry, Center=Point(0, 0, 0), Factor=series)  # -> Geometry, Transform
multiplication = Multiplication(A=series, B=height_multiplier)
offset_curve = OffsetCurve(Curve=scale.Geometry, Distance=wall_thickness, Plane=PlaneXY(0, 0, 0), Corners=1)
unit_z = UnitZ(Factor=multiplication)
merge = Merge(Data1=graft(scale.Geometry), Data2=offset_curve)
boundary_surfaces = BoundarySurfaces(Edges=merge)
boundary_surfaces_2 = BoundarySurfaces(Edges=offset_curve)
extrude = Extrude(Base=boundary_surfaces, Direction=graft(unit_z))
cap_thickness = Slider(1, range=0..3)
unit_z_2 = UnitZ(Factor=cap_thickness)
move = Move(Geometry=boundary_surfaces_2, Motion=graft(unit_z))  # -> Geometry, Transform
extrude_2 = Extrude(Base=move.Geometry, Direction=unit_z_2)
merge_2 = Merge(Data1=extrude, Data2=extrude_2)
solid_union = SolidUnion(Breps=merge_2)
