# Grasshopper definition lamp.gh (Grasshopper 1.0.7)

cylinder_thickness = Slider(2, range=1..100)
cylinder_radius = Slider(34, range=1..100)
cylinder_height = Slider(175, range=1..200)
circle = Circle(Plane=PlaneXY(0, 0, 0), Radius=cylinder_radius)
offset_curve = OffsetCurve(Curve=circle, Distance=cylinder_thickness, Plane=PlaneXY(0, 0, 0), Corners=1)
vector_xyz = VectorXYZ(XComponent=0, YComponent=0, ZComponent=cylinder_height)  # -> Vector, Length
merge = Merge(Data1=flatten(circle), Data2=flatten(offset_curve))
boundary_surfaces = BoundarySurfaces(Edges=merge)
extrude = Extrude(Base=boundary_surfaces, Direction=vector_xyz.Vector)

holes_per_row = Slider(32, range=0..50)
no_of_rows = Slider(10, range=0..50)
path = FilePath("/Users/khang/Documents/repo/local/hcde598/a5/primes.txt")
read_file = ReadFile(File=path, PerLineParse=True)
elevation = Slider(7, range=0..50)
series = Series(Start=0, Step=1, Count=no_of_rows)
panel = Panel(read_file)
ghpython_script = GhPythonScript(x=read_file, y=holes_per_row, z=no_of_rows)  # -> out, a
# ---------- ghpython_script: Python ----------
__author__ = "khang"

import rhinoscriptsyntax as rs

import Rhino.Geometry as rg
from clr import AddReference as addr
addr("Grasshopper")

from System import Object
from Grasshopper import DataTree
from Grasshopper.Kernel.Data import GH_Path

# --------------------------------------------------

def list_to_tree(input):
    list = input
    result = DataTree[object]()
    
    for i in range(len(list)):
        temp = []
        
        for j in range(len(list[i])):
            temp.append(list[i][j])
            
        path = GH_Path(i)
        result.AddRange(temp, path)
        
    return result

# --------------------------------------------------

rows = int(z)    
cpr = int(y)
output = []

angle = 360 / cpr

# split input string into a comma seperated list
# of the first 500 elements and cast it to int.
primes = [ int(i) for i in x.split(",")[:500] ]

for row in range(rows):
   temp = [ angle * int(item) for item in primes if int(item) < cpr ]
   print(temp)
   output.append(temp)
   primes = primes[len(temp):]
   primes = [val - cpr for val in primes]

a = list_to_tree(output)
# ---------- end ghpython_script ----------
multiplication = Multiplication(A=series, B=elevation)
vector_xyz_2 = VectorXYZ(XComponent=0, YComponent=0, ZComponent=multiplication)  # -> graft(Vector), Length
panel_2 = Panel(ghpython_script.a)

circle_radius = Slider(3, range=1..10)
hole_punch_length = Slider(80, range=1..100)
plane = Plane(PlaneYZ(0, 0, 0))
circle_2 = Circle(Plane=plane, Radius=circle_radius)
vector_xyz_3 = VectorXYZ(XComponent=hole_punch_length, YComponent=0, ZComponent=0)  # -> Vector, Length
boundary_surfaces_2 = BoundarySurfaces(Edges=circle_2)
extrude_2 = Extrude(Base=boundary_surfaces_2, Direction=vector_xyz_3.Vector)
cap_holes = CapHoles(Brep=extrude_2)

number_slider = Slider(2, range=1..6)
hole_punch_length_2 = Slider(2, range=1..100)
rectangle = Rectangle(Plane=PlaneXY(0, 0, 0), XSize=number_slider, YSize=number_slider, Radius=0)  # -> Rectangle, Length
vector_xyz_4 = VectorXYZ(XComponent=0, YComponent=0, ZComponent=hole_punch_length_2)  # -> Vector, Length
addition = Addition(A=cylinder_radius, B=1)
extrude_3 = Extrude(Base=rectangle.Rectangle, Direction=vector_xyz_4.Vector)
vector_xyz_5 = VectorXYZ(XComponent=addition, YComponent=-1, ZComponent=0)  # -> Vector, Length
cap_holes_2 = CapHoles(Brep=extrude_3)
move = Move(Geometry=cap_holes_2, Motion=vector_xyz_5.Vector)  # -> Geometry, Transform

move_2 = Move(Geometry=cap_holes, Motion=vector_xyz_2.Vector)  # -> Geometry, Transform
list_length = ListLength(List=ghpython_script.a)
duplicate_data = DuplicateData(Data=move_2.Geometry, Number=list_length, Order=True)
explode_tree = ExplodeTree(Data=duplicate_data)  # -> _0000, _0010, _0020, _0030, _0040, _0050, _0060, _0070, _0080, _0090
explode_tree_2 = ExplodeTree(Data=ghpython_script.a)  # -> Branch0, Branch1, Branch2, Branch3, Branch4, Branch5, Branch6, Branch7, Branch8, Branch9
rotate = Rotate(Geometry=explode_tree._0000, Angle=degrees(explode_tree_2.Branch0), Plane=PlaneXY(0, 0, 0))  # -> Geometry, Transform
rotate_2 = Rotate(Geometry=explode_tree._0010, Angle=degrees(explode_tree_2.Branch1), Plane=PlaneXY(0, 0, 0))  # -> Geometry, Transform
rotate_3 = Rotate(Geometry=explode_tree._0020, Angle=degrees(explode_tree_2.Branch2), Plane=PlaneXY(0, 0, 0))  # -> Geometry, Transform
rotate_4 = Rotate(Geometry=explode_tree._0030, Angle=degrees(explode_tree_2.Branch3), Plane=PlaneXY(0, 0, 0))  # -> Geometry, Transform
rotate_5 = Rotate(Geometry=explode_tree._0060, Angle=degrees(explode_tree_2.Branch6), Plane=PlaneXY(0, 0, 0))  # -> Geometry, Transform
rotate_6 = Rotate(Geometry=explode_tree._0040, Angle=degrees(explode_tree_2.Branch4), Plane=PlaneXY(0, 0, 0))  # -> Geometry, Transform
rotate_7 = Rotate(Geometry=explode_tree._0050, Angle=degrees(explode_tree_2.Branch5), Plane=PlaneXY(0, 0, 0))  # -> Geometry, Transform
rotate_8 = Rotate(Geometry=explode_tree._0070, Angle=degrees(explode_tree_2.Branch7), Plane=PlaneXY(0, 0, 0))  # -> Geometry, Transform
rotate_9 = Rotate(Geometry=explode_tree._0090, Angle=degrees(explode_tree_2.Branch9), Plane=PlaneXY(0, 0, 0))  # -> Geometry, Transform
rotate_10 = Rotate(Geometry=explode_tree._0080, Angle=degrees(explode_tree_2.Branch8), Plane=PlaneXY(0, 0, 0))  # -> Geometry, Transform
merge_2 = Merge(
    Data1=rotate.Geometry,
    Data2=rotate_2.Geometry,
    Data3=rotate_3.Geometry,
    Data4=rotate_4.Geometry,
    Data5=rotate_6.Geometry,
    Data6=rotate_7.Geometry,
    Data7=rotate_5.Geometry,
    Data8=rotate_8.Geometry,
    Data9=rotate_10.Geometry,
    Data10=rotate_9.Geometry)  # -> flatten(Result)

addition_2 = Addition(B=vector_xyz.Vector)

plane_2 = Plane(PlaneXY(0, 0, 0))
circle_3 = Circle(Plane=plane_2, Radius=circle_radius)
boundary_surfaces_3 = BoundarySurfaces(Edges=circle_3)
extrude_4 = Extrude(Base=boundary_surfaces_3, Direction=addition_2)
cap_holes_3 = CapHoles(Brep=extrude_4)

solid_difference = SolidDifference(BrepsA=extrude, BrepsB=move.Geometry)

offset = Slider(86, range=0..200)
addition_3 = Addition(A=offset, B=elevation)
vector_xyz_6 = VectorXYZ(XComponent=0, YComponent=0, ZComponent=addition_3)  # -> graft(Vector), Length
move_3 = Move(Geometry=merge_2, Motion=vector_xyz_6.Vector)  # -> Geometry, Transform
solid_union = SolidUnion(Breps=[cap_holes_3, move_3.Geometry])
solid_difference_2 = SolidDifference(BrepsA=solid_difference, BrepsB=solid_union)  # -> flatten(Result)
list_item = ListItem(List=solid_difference_2, Index=1, Wrap=True)
